# Grasshopper definition 3D curve to g-code-fix-end-code.gh (Grasshopper 0.9.64)

_3d_curves_for_toolpath = Curve([<curve referenced from the Rhino model> x14])
safe_z_height = Number(Slider(10, range=0..20))
resample_curve = Integer(Toggle(True))
sample_tolerance_in_mm = Number(Slider(0.02, range=0.02..0.1))
# 3D curve to g-code - to Kenji from Jens
toolpaths = Curve(_3d_curves_for_toolpath)
feed_rate = Number(Slider(3000, range=0..3000))
plunge_rate = Number(Slider(14, range=0..100))
home_x = Number(Slider(0, range=0..1000))
jog_rate = Number(Slider(100, range=0..200))
home_y = Number(Slider(0, range=0..1000))
topoly = CurveToPolyline(Curve=toolpaths, ToleranceDistance=sample_tolerance_in_mm, ToleranceAngle=0)  # -> Polyline, Segments
filter = StreamFilter(Gate=resample_curve, Stream0=toolpaths, Stream1=topoly.Polyline)
cp = ControlPoints(Curve=filter)  # -> Points, Weights, Knots
rev = ReverseList(List=cp.Points)
safe_z_height_2 = Number(safe_z_height)
item = ListItem(List=cp.Points, Index=0, Wrap=True)
item_2 = ListItem(List=rev, Index=0, Wrap=True)
pdecon = Deconstruct(Point=item)  # -> XComponent, YComponent, ZComponent
pdecon_2 = Deconstruct(Point=item_2)  # -> XComponent, YComponent, ZComponent
pt = ConstructPoint(XCoordinate=pdecon.XComponent, YCoordinate=pdecon.YComponent, ZCoordinate=safe_z_height_2)
pt_2 = ConstructPoint(XCoordinate=pdecon_2.XComponent, YCoordinate=pdecon_2.YComponent, ZCoordinate=safe_z_height_2)

toolpath_points = Point(cp.Points)
flatten = FlattenTree(Tree=toolpath_points, Path="{0}")
lng = ListLength(List=flatten)
feed_rate_2 = Number(feed_rate)
dup = DuplicateData(Data=graft(feed_rate_2), Number=graft(lng), Order=True)
lng_2 = ListLength(List=toolpath_points)
dup_2 = DuplicateData(Data=flatten("F"), Number=flatten(lng), Order=True)
dup_3 = DuplicateData(Data=flatten(" X"), Number=flatten(lng), Order=True)
flatten_2 = FlattenTree(Tree=dup_2, Path="{0}")
flatten_3 = FlattenTree(Tree=dup_3, Path="{0}")
flatten_4 = FlattenTree(Tree=dup, Path="{0}")
pdecon_3 = Deconstruct(Point=toolpath_points)  # -> XComponent, YComponent, ZComponent
graft = GraftTree(Tree=flatten_2, IncludeEmptyLists=True, IncludeNullItems=True)
graft_2 = GraftTree(Tree=flatten_4, IncludeEmptyLists=True, IncludeNullItems=True)
graft_3 = GraftTree(Tree=flatten_3, IncludeEmptyLists=True, IncludeNullItems=True)
panel = Panel(pdecon_3.XComponent)
panel_2 = Panel(pdecon_3.YComponent)
panel_3 = Panel(pdecon_3.ZComponent)
join = TextJoin(Text=[graft, graft_2, graft_3])
dup_4 = DuplicateData(Data=" Z", Number=lng_2, Order=True)
dup_5 = DuplicateData(Data=" Y", Number=lng_2, Order=True)
dup_6 = DuplicateData(Data="G1 ", Number=lng_2, Order=True)
simplify = SimplifyTree(Tree=flatten(join), Front=False)
simplify_2 = SimplifyTree(Tree=flatten(dup_6), Front=False)
simplify_3 = SimplifyTree(Tree=flatten(panel), Front=False)
simplify_4 = SimplifyTree(Tree=flatten(dup_5), Front=False)
simplify_5 = SimplifyTree(Tree=flatten(panel_2), Front=False)
simplify_6 = SimplifyTree(Tree=flatten(dup_4), Front=False)
simplify_7 = SimplifyTree(Tree=flatten(panel_3), Front=False)
graft_4 = GraftTree(Tree=simplify_2, IncludeEmptyLists=True, IncludeNullItems=True)
graft_5 = GraftTree(Tree=simplify_3, IncludeEmptyLists=True, IncludeNullItems=True)
graft_6 = GraftTree(Tree=simplify_4, IncludeEmptyLists=True, IncludeNullItems=True)
graft_7 = GraftTree(Tree=simplify_5, IncludeEmptyLists=True, IncludeNullItems=True)
graft_8 = GraftTree(Tree=simplify_6, IncludeEmptyLists=True, IncludeNullItems=True)
graft_9 = GraftTree(Tree=simplify_7, IncludeEmptyLists=True, IncludeNullItems=True)
graft_10 = GraftTree(Tree=simplify, IncludeEmptyLists=True, IncludeNullItems=True)
join_2 = TextJoin(Text=[graft_4, graft_10, graft_5, graft_6, graft_7, graft_8, graft_9])
flatten_5 = FlattenTree(Tree=join_2, Path="{0}")
panel_4 = Panel(flatten_5)

# ---- group: Toolapths preview
safe_z_start_point = Point(pt)
safe_z_end_point = Point(pt_2)
toolpath_points_2 = Point(flatten(cp.Points))
rev_2 = ReverseList(List=flatten(safe_z_end_point))
route_previvew_position = Number(Slider(0, range=0..1))
lng_3 = ListLength(List=toolpath_points_2)
cull_i = CullIndex(List=flatten(safe_z_start_point), Indices=0, Wrap=True)
cull_i_2 = CullIndex(List=rev_2, Indices=0, Wrap=True)
rev_3 = ReverseList(List=flatten(cull_i_2))
number_slider = Slider(3, range=0..10)
multiplication = Multiplication(A=lng_3, B=route_previvew_position)
ln = Line(StartPoint=safe_z_start_point, EndPoint=item)
ln_2 = Line(StartPoint=rev_3, EndPoint=cull_i)
ln_3 = Line(StartPoint=item_2, EndPoint=safe_z_end_point)
item_3 = ListItem(List=toolpath_points_2, Index=multiplication, Wrap=True)
toolpath_preview_line = Curve(filter)
cut_transition_preview_line = Curve(ln_2)
cut_entry_preview_line = Curve(ln)
cut_exit_preview_line = Curve(ln_3)
material = CreateMaterial(
    Diffuse=ColourSwatch(SwatchColor=RGB(130, 249, 255)),
    Specular=RGB(255, 255, 255),
    Emission=RGB(0, 0, 0),
    Transparency=0,
    Shine=0)
material_2 = CreateMaterial(
    Diffuse=ColourSwatch(SwatchColor=RGB(99, 74, 16)),
    Specular=RGB(255, 255, 255),
    Emission=RGB(0, 0, 0),
    Transparency=0,
    Shine=0)
material_3 = CreateMaterial(
    Diffuse=ColourSwatch(SwatchColor=RGB(174, 234, 235)),
    Specular=RGB(255, 255, 255),
    Emission=RGB(0, 0, 0),
    Transparency=0,
    Shine=0)
material_4 = CreateMaterial(
    Diffuse=ColourSwatch(SwatchColor=RGB(77, 114, 115)),
    Specular=RGB(255, 255, 255),
    Emission=RGB(0, 0, 0),
    Transparency=0,
    Shine=0)
sph = Sphere(Base=item_3, Radius=Slider(0.8, range=0..10))
preview = CustomPreview(Geometry=toolpath_preview_line, Shader=material)
preview_2 = CustomPreview(Geometry=cut_transition_preview_line, Shader=material_2)
preview_3 = CustomPreview(Geometry=cut_entry_preview_line, Shader=material_3)
preview_4 = CustomPreview(Geometry=cut_exit_preview_line, Shader=material_4)

# ----
jog_rate_2 = Number(jog_rate)
item_4 = ListItem(List=pdecon_3.XComponent, Index=0, Wrap=True)
item_5 = ListItem(List=pdecon_3.YComponent, Index=0, Wrap=True)
int = Integer(jog_rate_2)
lng_4 = ListLength(List=flatten(item_4))
safe_z_height_3 = Number(safe_z_height)
lng_5 = ListLength(List=flatten(item_4))
join_3 = TextJoin(Text=["F", int, " X"])
dup_7 = DuplicateData(Data="G0 ", Number=lng_4, Order=True)
dup_8 = DuplicateData(Data=" Y", Number=lng_4, Order=True)
dup_9 = DuplicateData(Data=" Z", Number=lng_4, Order=True)
dup_10 = DuplicateData(Data=safe_z_height_3, Number=lng_4, Order=True)
dup_11 = DuplicateData(Data=join_3, Number=lng_5, Order=True)
simplify_8 = SimplifyTree(Tree=flatten(dup_7), Front=False)
simplify_9 = SimplifyTree(Tree=flatten(item_4), Front=False)
simplify_10 = SimplifyTree(Tree=flatten(dup_8), Front=False)
simplify_11 = SimplifyTree(Tree=flatten(item_5), Front=False)
simplify_12 = SimplifyTree(Tree=flatten(dup_9), Front=False)
simplify_13 = SimplifyTree(Tree=flatten(dup_10), Front=False)
simplify_14 = SimplifyTree(Tree=flatten(dup_11), Front=False)
graft_11 = GraftTree(Tree=simplify_8, IncludeEmptyLists=True, IncludeNullItems=True)
graft_12 = GraftTree(Tree=simplify_14, IncludeEmptyLists=True, IncludeNullItems=True)
graft_13 = GraftTree(Tree=simplify_9, IncludeEmptyLists=True, IncludeNullItems=True)
graft_14 = GraftTree(Tree=simplify_10, IncludeEmptyLists=True, IncludeNullItems=True)
graft_15 = GraftTree(Tree=simplify_11, IncludeEmptyLists=True, IncludeNullItems=True)
graft_16 = GraftTree(Tree=simplify_12, IncludeEmptyLists=True, IncludeNullItems=True)
graft_17 = GraftTree(Tree=simplify_13, IncludeEmptyLists=True, IncludeNullItems=True)
safe_z_height_4 = Number(safe_z_height)
join_4 = TextJoin(Text=[graft_11, graft_12, graft_13, graft_14, graft_15, graft_16, graft_17])
home_x_2 = Number(home_x)
home_y_2 = Number(home_y)
# 2015/05/09 Kenji
# I found minor trouble just before end code. The line reads “G0 F112 G0X X 0.0 Y 0.0 Z10.0”. “G0X” made trouble so that I disconnected the Panel named “G0 X” from Join.
panel_5 = Panel("G0 X")
flatten_6 = FlattenTree(Tree=join_4, Path="{0}")
join_5 = TextJoin(Text=["G0 ", join_3, home_x_2, " Y", home_y_2, " Z", safe_z_height_4])
merge = Merge(Data1=flatten(flatten_6), Data2=flatten(join_5))
panel_6 = Panel(merge)

ma = MassAddition(Input=flatten(lng_2))  # -> Result, PartialResults
merge_2 = Merge(Data1=Slider(0, range=0..100), Data2=ma.PartialResults)
ins = InsertItems(List=flatten(panel_4), Item=flatten(panel_6), Indices=flatten(merge_2), Wrap=True)

# ----
# 2015/05/09
# Kenji
# Just add M03 code for spidle start.
# Startcode - Ultimaker original , extruder upgrade + heatbed: M190 S70.000000
# M109 T0 S220.000000
# T0
# G21        ;metric values
# G90        ;absolute positioning
# M82        ;set extruder to absolute mode
# M107       ;start with the fan off
# G28 X0 Y0  ;move X/Y to min endstops
# G28 Z0     ;move Z to min endstops
# G1 Z15.0 F9000 ;move the platform down 15mm
# G92 E0                  ;zero the extruded length
# G1 F200 E17              ;extrude 17mm of feed stock
# G92 E0                  ;zero the extruded length again
# G1 F9000
# ;Put printing message on LCD screen
# M117 Bark beetle
startcode = Panel(""";enter suitable start code for your machine here
M03""")
# Startcode - Printrbot Simple: M190 S30.000000
# M109 S220.000000
# ;Sliced at: Mon 16-03-2015 21:37:50
# ;Basic settings: Layer height: 0.2 Walls: 0.8 Fill: 20
# ;Print time: 3 minutes
# ;Filament used: 0.151m 0.0g
# ;Filament cost: None
# ;M190 S30 ;Uncomment to add your own bed temperature line
# ;M109 S220 ;Uncomment to add your own temperature line
# G21        ;metric values
# G90        ;absolute positioning
# M82        ;set extruder to absolute mode
# M107       ;start with the fan off
# 
# G28 X0 Y0  ;move X/Y to min endstops
# G28 Z0     ;move Z to min endstops
# 
# G1 Z15.0 F9000 ;move the platform down 15mm
# 
# G92 E0                  ;zero the extruded length
# G1 F200 E6              ;extrude 6mm of feed stock
# G92 E0                  ;zero the extruded length again
# G1 F9000
# 2015/05/09
# Kenji
# Just add M05 code for spindle stop
# Endcode - Ultimaker original , extruder upgrade + heatbed: ;End GCode
# M104 S0                     ;extruder heater off
# M140 S0                     ;heated bed heater off (if you have it)
# G91                                    ;relative positioning
# G1 E-1 F300                            ;retract the filament a bit before lifting the nozzle, to release some of the pressure
# G1 Z+0.5 E-5 X-20 Y-20 F9000 ;move Z up a bit and retract filament even more
# G28 X0 Y0                              ;move X/Y to min endstops, so the head is out of the way
# M84                         ;steppers off
# G90                         ;absolute positioning
# Endcode - Printrbot Simple: M104 S0                     ;extruder heater off
# M140 S0                     ;heated bed heater off (if you have it)
# 
# G91                                    ;relative positioning
# G1 E-1 F300                            ;retract the filament a bit before lifting the nozzle, to release some of the pressure
# G1 Z+0.5 E-5 X-20 Y-20 F9000 ;move Z up a bit and retract filament even more
# G28 X0 Y0                              ;move X/Y to min endstops, so the head is out of the way
# 
# M84                         ;steppers off
# G90                         ;absolute positioning
endcode = Panel("""M05
;enter suitable end code for your machine here""")
merge_3 = Merge(Data1=flatten(startcode), Data2=flatten(ins), Data3=flatten(endcode))

# ---- group: Code preview in viewport
number_of_code_preview_lines = Slider(39, range=0..100)
code_preview_angle = Slider(90, range=0..100)
code_preview_font_size = Slider(3, range=0..100)
line_spacing_factor = Slider(1.45, range=1..2.5)
pt_3 = ConstructPoint(XCoordinate=Slider(66, range=0..1000), YCoordinate=Slider(-8, range=-1000..1000), ZCoordinate=0)
multiplication_2 = Multiplication(A=code_preview_font_size, B=line_spacing_factor)
Y = UnitY(Factor=1)
series = Series(Start=0, Step=multiplication_2, Count=number_of_code_preview_lines)
rev_4 = Reverse(Vector=Y)
Z = UnitZ(Factor=1)
split = SplitList(List=merge_3, Index=number_of_code_preview_lines)  # -> ListA, ListB
neg = Negative(Value=series)
pl = ConstructPlane(Origin=pt_3, XAxis=rev_4, YAxis=Z)
series_2 = Series(Start=0, Step=Slider(1, range=0..1), Count=number_of_code_preview_lines)
dup_12 = DuplicateData(Data=code_preview_font_size, Number=number_of_code_preview_lines, Order=True)
division = Division(A=series_2, B=number_of_code_preview_lines)
neg_2 = Negative(Value=code_preview_angle)
xz = XZPlane(Origin=pt_3)
rev_5 = ReverseList(List=division)
rotate = Rotate(Geometry=pl, Angle=degrees(neg_2), Plane=xz)  # -> Geometry, Transform
num = Number(rev_5)
argb = SplitARGB(Colour=ColourSwatch(SwatchColor=RGB(130, 232, 255)), IntegerChannels=True)  # -> Alpha, Red, Green, Blue
deplane = DeconstructPlane(Plane=rotate.Geometry)  # -> Origin, XAxis, YAxis, ZAxis
amp = Amplitude(Vector=deplane.YAxis, Amplitude=neg)
move = Move(Geometry=rotate.Geometry, Motion=amp)  # -> Geometry, Transform
multiplication_3 = Multiplication(A=argb.Red, B=num)
multiplication_4 = Multiplication(A=argb.Blue, B=num)
multiplication_5 = Multiplication(A=argb.Green, B=num)
rgb = ColourRGB(Alpha=255, Red=multiplication_3, Green=multiplication_5, Blue=multiplication_4)
tag = TextTag3D(Location=move.Geometry, Text=split.ListA, Size=dup_12, Colour=rgb, Justification=1)

# ----
# Rigth click and choose "Stream destination"
# 
# Give a file name ending with .gcode
# 
# Your toolpath will automatically be updated!
panel_7 = Panel(merge_3)
